# Grasshopper definition table5_1.gh (Grasshopper 0.9.70)

# ----
# INPUT
elbow_height = Slider(1002, range=1000..1500)
sheet_thickness = Slider(18, range=15..20)
table_top_thickness = Slider(18, range=15..26)
height = Slider(1706.8, range=1400..2000)

sheet_thickness_2 = Slider(18.3, range=14..30)
multiplication = Multiplication(A=elbow_height, B=-1)
addition = Addition(A=multiplication, B=1059.5)
subtraction = Subtraction(A=elbow_height, B=10)
# A-Frame
toplinetop = Geometry(<curve referenced from the Rhino model>)
leg = Geometry(<curve referenced from the Rhino model>)
cutting_line = Geometry(<curve referenced from the Rhino model>)
undertable = Geometry(<curve referenced from the Rhino model>)
addition_2 = Addition(A=addition, B=table_top_thickness)
Y = UnitY(Factor=subtraction)
subtraction_2 = Subtraction(A=subtraction, B=table_top_thickness)
neg = Negative(Value=table_top_thickness)
Y_2 = UnitY(Factor=height)
subtraction_3 = Subtraction(A=subtraction_2, B=155.5)
move = Move(Geometry=toplinetop, Motion=Y_2)  # -> Geometry, Transform
Y_3 = UnitY(Factor=neg)
Y_4 = UnitY(Factor=subtraction_3)
move_2 = Move(Geometry=undertable, Motion=Y_4)  # -> Geometry, Transform
line = Line(Line((9933.923353, 1273.101803, 0), (9933.923353, 2569.815787, 0)))
Y_5 = UnitY(Factor=table_top_thickness)
top_joint = Geometry(<curve referenced from the Rhino model>)
mowhawk = Geometry(<curve referenced from the Rhino model>)
top_joint_2 = Geometry(<curve referenced from the Rhino model>)
Y_6 = UnitY(Factor=height)
Y_7 = UnitY(Factor=height)
addition_3 = Addition(A=sheet_thickness, B=0.4)
end = EndPoints(Curve=move_2.Geometry)  # -> Start, End
move_3 = Move(Geometry=mowhawk, Motion=Y_5)  # -> Geometry, Transform
move_4 = Move(Geometry=top_joint, Motion=Y_7)  # -> Geometry, Transform
move_5 = Move(Geometry=top_joint_2, Motion=Y_6)  # -> Geometry, Transform
end_2 = EndPoints(Curve=move_3.Geometry)  # -> Start, End
X = UnitX(Factor=sheet_thickness_2)
move_6 = Move(Geometry=move_4.Geometry, Motion=X)  # -> Geometry, Transform
subtraction_4 = Subtraction(A=elbow_height, B=161)
end_3 = EndPoints(Curve=move_5.Geometry)  # -> Start, End
end_4 = EndPoints(Curve=move_6.Geometry)  # -> Start, End
subtraction_5 = Subtraction(A=subtraction_4, B=table_top_thickness)
X_2 = UnitX(Factor=sheet_thickness)
neg_2 = Negative(Value=subtraction_5)
ln = Line(StartPoint=end_4.End, EndPoint=end_3.End)
addition_4 = Addition(A=table_top_thickness, B=0.4)
X_3 = UnitX(Factor=1)
vertical_cutter = Geometry(<curve referenced from the Rhino model>)
line_2 = Line(Line((12918.34399, -33.90106524, 0), (12918.34399, -49.90106524, 0)))
top_bracket = Geometry(<curve referenced from the Rhino model>)
X_4 = UnitX(Factor=addition_4)
point2 = Geometry(<point referenced from the Rhino model>)
point = Geometry(<point referenced from the Rhino model>)
move_7 = Move(Geometry=line_2, Motion=X_4)  # -> Geometry, Transform
end_5 = EndPoints(Curve=line_2)  # -> Start, End
end_6 = EndPoints(Curve=move_7.Geometry)  # -> Start, End
ln_2 = Line(StartPoint=end_5.Start, EndPoint=end_6.Start)
X_5 = UnitX(Factor=sheet_thickness_2)
join = JoinCurves(Curves=[line_2, move_7.Geometry, ln_2], Preserve=False)  # -> flatten(Curves)
ccx = CurveCurve(CurveA=top_bracket, CurveB=join)  # -> Points, ParamsA, ParamsB
end_7 = EndPoints(Curve=top_bracket)  # -> Start, End
shatter = Shatter(Curve=top_bracket, Parameters=ccx.ParamsA)
cull_i = CullIndex(List=shatter, Indices=1, Wrap=True)  # -> flatten(List)
geo = Geometry(<curve referenced from the Rhino model>)
join_2 = JoinCurves(Curves=[join, cull_i], Preserve=False)
yz = YZPlane(Origin=end_7.Start)
mirror = Mirror(Geometry=join_2, Plane=yz)  # -> Geometry, Transform
end_8 = EndPoints(Curve=geo)  # -> Start, End
yz_2 = YZPlane(Origin=end_8.Start)
yz_3 = YZPlane(Origin=end_2.Start)
xz = XZPlane(Origin=end_8.End)

end_9 = EndPoints(Curve=move.Geometry)  # -> Start, End
end_10 = EndPoints(Curve=leg)  # -> Start, End
move_8 = Move(Geometry=cutting_line, Motion=Y)  # -> Geometry, Transform
move_9 = Move(Geometry=move_8.Geometry, Motion=Y_3)  # -> Geometry, Transform
ln_3 = Line(StartPoint=end_9.Start, EndPoint=end_10.Start)
end_11 = EndPoints(Curve=move_8.Geometry)  # -> Start, End
X_6 = UnitX(Factor=45)
ccx_2 = CurveCurve(CurveA=ln_3, CurveB=move_8.Geometry)  # -> Points, ParamsA, ParamsB
Y_8 = UnitY(Factor=1)
ccx_3 = CurveCurve(CurveA=ln_3, CurveB=move_9.Geometry)  # -> Points, ParamsA, ParamsB
move_10 = Move(Geometry=ccx_2.Points, Motion=X_6)  # -> Geometry, Transform
line_3 = LineSDL(Start=move_10.Geometry, Direction=Y_8, Length=neg)
ccx_4 = CurveCurve(CurveA=move_9.Geometry, CurveB=line_3)  # -> Points, ParamsA, ParamsB
ccx_5 = CurveCurve(CurveA=move_8.Geometry, CurveB=line_3)  # -> Points, ParamsA, ParamsB
shatter_2 = Shatter(Curve=ln_3, Parameters=[ccx_3.ParamsA, ccx_2.ParamsA])
shatter_3 = Shatter(Curve=move_9.Geometry, Parameters=ccx_3.ParamsB)
cull = CullPattern(List=shatter_3, CullPattern=[False, True])
shatter_4 = Shatter(Curve=move_8.Geometry, Parameters=ccx_2.ParamsB)
shatter_5 = Shatter(Curve=cull, Parameters=ccx_4.ParamsA)
cull_2 = CullPattern(List=shatter_4, CullPattern=[False, True])
cull_3 = CullPattern(List=shatter_5, CullPattern=[True, False])
shatter_6 = Shatter(Curve=cull_2, Parameters=ccx_5.ParamsA)
cull_4 = CullPattern(List=shatter_6, CullPattern=[True, False])
tabletoptab = JoinCurves(Curves=[cull_3, cull_4, line_3], Preserve=False)  # -> flatten(Curves)
dist = Distance(PointA=move_10.Geometry, PointB=end_11.End)

bottom_leg = Curve(<curve referenced from the Rhino model>)
top_surface = Curve(<curve referenced from the Rhino model>)
under_surface = Curve(<curve referenced from the Rhino model>)
Y_9 = UnitY(Factor=addition_2)
move_11 = Move(Geometry=bottom_leg, Motion=Y_9)  # -> Geometry, Transform
end_12 = EndPoints(Curve=move_11.Geometry)  # -> Start, End
end_13 = EndPoints(Curve=top_surface)  # -> Start, End
end_14 = EndPoints(Curve=under_surface)  # -> Start, End
ln_4 = Line(StartPoint=end_12.Start, EndPoint=end_13.End)
ln_5 = Line(StartPoint=end_12.End, EndPoint=end_14.Start)
join_3 = JoinCurves(Curves=[ln_5, under_surface], Preserve=False)
join_4 = JoinCurves(Curves=[ln_5, move_11.Geometry], Preserve=False)
fillet = Fillet(Curve=join_4, Radius="20")
fillet_2 = Fillet(Curve=join_3, Radius="65")
ccx_6 = CurveCurve(CurveA=fillet, CurveB=fillet_2)  # -> Points, ParamsA, ParamsB
item = ListItem(List=ccx_6.ParamsA, Index=Slider(0, range=0..1), Wrap=True)
item_2 = ListItem(List=ccx_6.ParamsB, Index=Slider(0, range=0..1), Wrap=True)
shatter_7 = Shatter(Curve=fillet, Parameters=item)
shatter_8 = Shatter(Curve=fillet_2, Parameters=item_2)
cull_i_2 = CullIndex(List=shatter_7, Indices=Slider(1, range=0..1), Wrap=True)
cull_i_3 = CullIndex(List=shatter_8, Indices=Slider(0, range=0..1), Wrap=True)
geo_2 = Geometry(flatten(cull_i_3))
geo_3 = Geometry(cull_i_2)

X_7 = UnitX(Factor=addition_3)
bottom_half = Geometry(<curve referenced from the Rhino model>)
middle_bit = Geometry(<curve referenced from the Rhino model>)
top_half = Geometry(<curve referenced from the Rhino model>)
move_12 = Move(Geometry=middle_bit, Motion=X_7)  # -> Geometry, Transform
end_15 = EndPoints(Curve=bottom_half)  # -> Start, End
end_16 = EndPoints(Curve=top_half)  # -> Start, End
end_17 = EndPoints(Curve=move_12.Geometry)  # -> Start, End
ln_6 = Line(StartPoint=end_15.Start, EndPoint=end_17.End)
ln_7 = Line(StartPoint=end_17.Start, EndPoint=end_16.End)
yz_4 = YZPlane(Origin=end_16.Start)
join_5 = JoinCurves(Curves=[ln_6, ln_7, bottom_half, top_half, move_12.Geometry], Preserve=False)
mirror_2 = Mirror(Geometry=join_5, Plane=yz_4)  # -> Geometry, Transform

Y_10 = UnitY(Factor=-50.8)
Y_11 = UnitY(Factor=14)
move_13 = Move(Geometry=move.Geometry, Motion=Y_10)  # -> Geometry, Transform
move_14 = Move(Geometry=move_8.Geometry, Motion=Y_11)  # -> Geometry, Transform
neg_3 = Negative(Value=Slider(2500, range=100..2500))
insideoftri = LineSDL(Start=end_10.End, Direction=ln_3, Length=neg_3)
ccx_7 = CurveCurve(CurveA=insideoftri, CurveB=move_14.Geometry)  # -> Points, ParamsA, ParamsB
ccx_8 = CurveCurve(CurveA=insideoftri, CurveB=move_13.Geometry)  # -> Points, ParamsA, ParamsB
shatter_9 = Shatter(Curve=insideoftri, Parameters=[ccx_7.ParamsA, ccx_8.ParamsA])
shatter_10 = Shatter(Curve=move_14.Geometry, Parameters=ccx_7.ParamsB)
shatter_11 = Shatter(Curve=move_13.Geometry, Parameters=ccx_8.ParamsB)
cull_5 = CullPattern(List=shatter_9, CullPattern=[False, True, False])
cull_6 = CullPattern(List=shatter_11, CullPattern=[False, True, False])
cull_7 = CullPattern(List=shatter_10, CullPattern=[False, True, False])  # -> flatten(List)
number_slider = Slider(30, range=20..40)
join_6 = JoinCurves(Curves=[cull_6, cull_5], Preserve=False)  # -> flatten(Curves)
end_18 = EndPoints(Curve=cull_6)  # -> Start, End
fillet_3 = Fillet(Curve=join_6, Parameter=number_slider, Radius=number_slider)  # -> flatten(Curve), Parameter
join_7 = JoinCurves(Curves=[cull_7, fillet_3.Curve], Preserve=False)
yz_5 = YZPlane(Origin=end_18.End)
fillet_4 = Fillet(Curve=join_7, Radius=number_slider)  # -> flatten(Curve)
mirror_3 = Mirror(Geometry=fillet_4, Plane=yz_5)  # -> flatten(Geometry), Transform
join_8 = JoinCurves(Curves=[mirror_3.Geometry, fillet_4], Preserve=False)

bottom_leg_2 = Curve(<curve referenced from the Rhino model>)
under_surface_2 = Curve(<curve referenced from the Rhino model>)
top_surface_2 = Curve(<curve referenced from the Rhino model>)
X_8 = UnitX(Factor=sheet_thickness)
end_19 = EndPoints(Curve=under_surface_2)  # -> Start, End
end_20 = EndPoints(Curve=top_surface_2)  # -> Start, End
Y_12 = UnitY(Factor=1)
end_21 = EndPoints(Curve=top_surface_2)  # -> Start, End
yz_6 = YZPlane(Origin=end_21.Start)

bottom_line = CullPattern(List=shatter_2, CullPattern=[False, False, True])
angle = Angle(VectorA=ln_4, VectorB=line)  # -> Angle, Reflex
xy = XYPlane(Origin=end_12.Start)
rotate = Rotate(Geometry=ln_4, Angle=angle.Angle, Plane=xy)  # -> Geometry, Transform
divide = DivideCurve(Curve=rotate.Geometry, Count=6, Kinks=False)  # -> Points, Tangents, Parameters
ln_8 = Line(StartPoint=end_2.End, EndPoint=end_13.Start)
shatter_12 = Shatter(Curve=rotate.Geometry, Parameters=divide.Parameters)
cull_8 = CullPattern(List=shatter_12, CullPattern=[True, False, True, False, True, False])
multiplication_2 = Multiplication(A=angle.Angle, B=-1)
end_22 = EndPoints(Curve=ln_4)  # -> Start, End
move_15 = Move(Geometry=cull_8, Motion=X_2)  # -> Geometry, Transform
top_line = CullPattern(List=shatter_2, CullPattern=[True, False, False])  # -> flatten(List)
end_23 = EndPoints(Curve=cull_8)  # -> Start, End
join_9 = JoinCurves(Curves=[top_line, move.Geometry], Preserve=False)  # -> flatten(Curves)
end_24 = EndPoints(Curve=move_15.Geometry)  # -> Start, End
ln_9 = Line(StartPoint=end_23.Start, EndPoint=end_24.Start)
ln_10 = Line(StartPoint=end_23.End, EndPoint=end_24.End)
fillet_5 = Fillet(Curve=join_9, Radius=Slider(20, range=10..25))
ccx_9 = CurveCurve(CurveA=move_5.Geometry, CurveB=fillet_5)  # -> Points, ParamsA, ParamsB
ccx_10 = CurveCurve(CurveA=move_6.Geometry, CurveB=fillet_5)  # -> Points, ParamsA, ParamsB
shatter_13 = Shatter(Curve=fillet_5, Parameters=[ccx_9.ParamsB, ccx_10.ParamsB])
cull_9 = CullPattern(List=shatter_12, CullPattern=[False, True, False, True, False, True])
cull_10 = CullPattern(List=shatter_13, CullPattern=[True, False, True])  # -> flatten(List)
cull_11 = CullPattern(List=ln_9, CullPattern=[False, True, True])
Y_13 = UnitY(Factor=dist)
move_16 = Move(Geometry=point2, Motion=Y_13)  # -> Geometry, Transform
group = Group(Objects=[cull_9, cull_11, ln_10, move_15.Geometry])
rotate_2 = Rotate(Geometry=group, Angle=multiplication_2, Plane=xy)  # -> Geometry, Transform
ln_11 = Line(StartPoint=move_16.Geometry, EndPoint=point)
move_17 = Move(Geometry=ln_11, Motion=X_5)  # -> flatten(Geometry), Transform
ungroup = Ungroup(Group=rotate_2.Geometry)
end_25 = EndPoints(Curve=ln_11)  # -> Start, End
end_26 = EndPoints(Curve=move_17.Geometry)  # -> Start, End
join_10 = JoinCurves(Curves=ungroup, Preserve=False)  # -> flatten(Curves)
end_27 = EndPoints(Curve=join_10)  # -> Start, End
ccx_11 = CurveCurve(CurveA=geo_3, CurveB=join_10)  # -> Points, ParamsA, ParamsB
ln_12 = Line(StartPoint=end_27.Start, EndPoint=ccx_11.Points)
shatter_14 = Shatter(Curve=join_10, Parameters=ccx_11.ParamsB)
rev = Reverse(Vector=ln_12)
ln_13 = Line(StartPoint=end_26.Start, EndPoint=end_25.Start)  # -> flatten(Line)
shatter_15 = Shatter(Curve=geo_3, Parameters=ccx_11.ParamsA)
item_3 = ListItem(List=ungroup, Index=10, Wrap=True)
side_joints = CullPattern(List=shatter_14, CullPattern=[False, True])  # -> flatten(List)
bottom = CullPattern(List=shatter_15, CullPattern=[False, True])  # -> flatten(List)
move_18 = Move(Geometry=bottom, Motion=rev)  # -> flatten(Geometry), Transform
ccx_12 = CurveCurve(CurveA=ln_13, CurveB=geo)  # -> Points, ParamsA, ParamsB
end_28 = EndPoints(Curve=item_3)  # -> Start, End
end_29 = EndPoints(Curve=geo_2)  # -> Start, End
end_30 = EndPoints(Curve=move_18.Geometry)  # -> Start, End
shatter_16 = Shatter(Curve=geo, Parameters=ccx_12.ParamsB)  # -> flatten(Segments)
ext = ExtendCurve(Curve=item_3, Type=expr("0", 0), Start=end_28.End, End=Slider(536, range=0..536))
join_11 = JoinCurves(Curves=[ln_8, move_3.Geometry, top_surface], Preserve=False)
ln_14 = Line(StartPoint=end_30.End, EndPoint=end_29.Start)
join_12 = JoinCurves(Curves=[geo_2, move_18.Geometry, ln_14], Preserve=False)
cull_12 = CullPattern(List=shatter_16, CullPattern=[True, False])  # -> flatten(List)
ccx_13 = CurveCurve(CurveA=top_surface, CurveB=ext)  # -> Points, ParamsA, ParamsB
join_13 = JoinCurves(Curves=[cull_12, ln_13, move_17.Geometry], Preserve=False)  # -> flatten(Curves)
join_14 = JoinCurves(Curves=[join_12, join_11, join_10], Preserve=False)
mirror_4 = Mirror(Geometry=join_14, Plane=yz_3)  # -> Geometry, Transform
ln_15 = Line(StartPoint=end_30.Start, EndPoint=ccx_13.Points)
mirror_5 = Mirror(Geometry=join_13, Plane=yz_2)  # -> flatten(Geometry), Transform
join_15 = JoinCurves(Curves=[join_13, mirror_5.Geometry], Preserve=False)  # -> flatten(Curves)
join_16 = JoinCurves(Curves=[cull_10, ln, move_6.Geometry, move_5.Geometry], Preserve=False)  # -> flatten(Curves)
mirror_6 = Mirror(Geometry=join_15, Plane=xz)  # -> flatten(Geometry), Transform

# ----
# NO-FRAME
dist_2 = Distance(PointA=end_22.Start, PointB=end_22.End)
multiplication_3 = Multiplication(A=dist_2, B=-1)  # -> flatten(Result)
Y_14 = UnitY(Factor=multiplication_3)
move_19 = Move(Geometry=bottom_leg_2, Motion=Y_14)  # -> Geometry, Transform
end_31 = EndPoints(Curve=move_19.Geometry)  # -> Start, End
ln_16 = Line(StartPoint=end_31.Start, EndPoint=end_20.End)
divide_2 = DivideCurve(Curve=ln_16, Count=6, Kinks=False)  # -> Points, Tangents, Parameters
shatter_17 = Shatter(Curve=ln_16, Parameters=divide_2.Parameters)
cull_13 = CullPattern(List=shatter_17, CullPattern=[False, True, False, True, False, True])
move_20 = Move(Geometry=cull_13, Motion=X_8)  # -> Geometry, Transform
ln_17 = Line(StartPoint=end_31.End, EndPoint=end_19.End)
end_32 = EndPoints(Curve=cull_13)  # -> Start, End
end_33 = EndPoints(Curve=move_20.Geometry)  # -> Start, End
join_17 = JoinCurves(Curves=[ln_17, under_surface_2], Preserve=False)
ln_18 = Line(StartPoint=end_32.End, EndPoint=end_33.End)
fillet_6 = Fillet(Curve=join_17, Radius=Slider(65, range=40..120))  # -> flatten(Curve)
join_18 = JoinCurves(Curves=[move_19.Geometry, fillet_6], Preserve=False)
ln_19 = Line(StartPoint=end_32.Start, EndPoint=end_33.Start)
cull_14 = CullPattern(List=ln_18, CullPattern=[True, True, False])
offset = Offset(Curve=ln_19, Distance=0.4, Plane=PlaneXY(0, 0, 0), Corners=1)  # -> flatten(Curve)
offset_2 = Offset(Curve=cull_14, Distance=-0.4, Plane=PlaneXY(0, 0, 0), Corners=1)  # -> flatten(Curve)
end_34 = EndPoints(Curve=offset_2)  # -> Start, End
end_35 = EndPoints(Curve=offset)  # -> Start, End
cull_15 = CullPattern(List=end_34.Start, CullPattern=[True, False])
cull_16 = CullPattern(List=end_34.End, CullPattern=[False, True, False])
cull_17 = CullPattern(List=end_34.End, CullPattern=[True, False, False])
cull_18 = CullPattern(List=end_35.End, CullPattern=[False, False, True])
cull_19 = CullPattern(List=end_35.End, CullPattern=[True, False, False])
cull_20 = CullPattern(List=end_35.End, CullPattern=[False, True, False])
cull_21 = CullPattern(List=end_34.Start, CullPattern=[False, True])
cull_22 = CullPattern(List=end_35.Start, CullPattern=[False, False, True])
cull_23 = CullPattern(List=end_35.Start, CullPattern=[False, True, False])
cull_24 = CullPattern(List=end_35.Start, CullPattern=[True, False, False])
ln_20 = Line(StartPoint=cull_23, EndPoint=cull_15)
ln_21 = Line(StartPoint=cull_24, EndPoint=end_31.Start)
ln_22 = Line(StartPoint=cull_22, EndPoint=cull_21)
line_4 = LineSDL(Start=cull_18, Direction=Y_12, Length=Slider(600, range=0..600))
ln_23 = Line(StartPoint=cull_17, EndPoint=cull_19)
ln_24 = Line(StartPoint=cull_16, EndPoint=cull_20)
ccx_14 = CurveCurve(CurveA=line_4, CurveB=top_surface_2)  # -> Points, ParamsA, ParamsB
shatter_18 = Shatter(Curve=top_surface_2, Parameters=ccx_14.ParamsB)
shatter_19 = Shatter(Curve=line_4, Parameters=ccx_14.ParamsA)
cull_25 = CullPattern(List=shatter_18, CullPattern=[True, False])
cull_26 = CullPattern(List=shatter_19, CullPattern=[True, False])
join_19 = JoinCurves(Curves=[ln_23, ln_24, ln_22, ln_21, ln_20, offset, offset_2], Preserve=False)  # -> flatten(Curves)
join_20 = JoinCurves(Curves=[cull_26, cull_25], Preserve=False)  # -> flatten(Curves)
join_21 = JoinCurves(Curves=[join_19, join_20], Preserve=False)  # -> flatten(Curves)

geo_4 = Geometry(<curve referenced from the Rhino model>)
xy_2 = XYPlane(Origin=end_10.Start)
pi = Pi(Factor=1)
angle_2 = Angle(VectorA=geo_4, VectorB=bottom_line, Plane=xy_2)  # -> Angle, Reflex
addition_5 = Addition(A=angle_2.Reflex, B=pi)
rotate_3 = Rotate(Geometry=bottom_line, Angle=addition_5, Plane=xy_2)  # -> Geometry, Transform
X_9 = UnitX(Factor=sheet_thickness_2)
divide_3 = DivideCurve(Curve=rotate_3.Geometry, Count=6, Kinks=False)  # -> Points, Tangents, Parameters
multiplication_4 = Multiplication(A=addition_5, B=-1)
shatter_20 = Shatter(Curve=rotate_3.Geometry, Parameters=divide_3.Parameters)
cull_27 = CullPattern(List=shatter_20, CullPattern=[False, True, False, True, False, True])
move_21 = Move(Geometry=cull_27, Motion=X_9)  # -> Geometry, Transform
end_36 = EndPoints(Curve=cull_27)  # -> Start, End
end_37 = EndPoints(Curve=move_21.Geometry)  # -> Start, End
ln_25 = Line(StartPoint=end_36.Start, EndPoint=end_37.Start)
ln_26 = Line(StartPoint=end_36.End, EndPoint=end_37.End)  # -> flatten(Line)
cull_28 = CullPattern(List=shatter_20, CullPattern=[True, False, True, False, True, False])

cull_29 = CullPattern(List=ln_26, CullPattern=[True, True, False])
fillet_7 = Fillet(Curve=join_18, Parameter=0, Radius=Slider(30, range=19..30))  # -> flatten(Curve), Parameter

group_2 = Group(Objects=[cull_28, move_21.Geometry, ln_25, cull_29])
rotate_4 = Rotate(Geometry=group_2, Angle=multiplication_4, Plane=xy_2)  # -> Geometry, Transform
ungroup_2 = Ungroup(Group=rotate_4.Geometry)  # -> flatten(Objects)
join_22 = JoinCurves(Curves=ungroup_2, Preserve=False)

geo_5 = Geometry(fillet_7.Curve)
join_23 = JoinCurves(Curves=[join_21, geo_5], Preserve=False)
flatten = FlattenTree(Tree=join_23, Path="{0}")
mirror_7 = Mirror(Geometry=flatten, Plane=yz_6)  # -> Geometry, Transform
flatten_2 = FlattenTree(Tree=flatten, Path="{0}")

ccx_15 = CurveCurve(CurveA=join_22, CurveB=leg)  # -> Points, ParamsA, reverse(ParamsB)
end_38 = EndPoints(Curve=join_22)  # -> Start, End
vec2pt = Vector2Pt(PointA=ccx_15.Points, PointB=end_38.End, Unitize=False)  # -> Vector, Length
move_22 = Move(Geometry=leg, Motion=vec2pt.Vector)  # -> Geometry, Transform
end_39 = EndPoints(Curve=move_22.Geometry)  # -> Start, End
insideofleg = LineSDL(Start=end_39.End, Direction=ln_3, Length=neg_2)  # -> flatten(Line)
end_40 = EndPoints(Curve=insideofleg)  # -> Start, End
line_5 = LineSDL(Start=end_40.End, Direction=X_3, Length=Slider(240, range=100..240))
ccx_16 = CurveCurve(CurveA=line_5, CurveB=vertical_cutter)  # -> Points, ParamsA, ParamsB
shatter_21 = Shatter(Curve=line_5, Parameters=ccx_16.ParamsA)
underbelly = CullPattern(List=shatter_21, CullPattern=[True, False])  # -> flatten(List)
ccx_17 = CurveCurve(CurveA=move_22.Geometry, CurveB=join_22)  # -> Points, ParamsA, ParamsB
end_41 = EndPoints(Curve=geo_5)  # -> Start, End
shatter_22 = Shatter(Curve=move_22.Geometry, Parameters=ccx_17.ParamsA)
cull_30 = CullPattern(List=shatter_22, CullPattern=[False, True])  # -> flatten(List)
join_24 = JoinCurves(Curves=[insideofleg, cull_30], Preserve=False)
fillet_8 = Fillet(Curve=join_24, Radius=Slider(20, range=0..25))  # -> flatten(Curve)
join_25 = JoinCurves(Curves=[underbelly, fillet_8], Preserve=False)
flatten_3 = FlattenTree(Tree=join_22, Path="{0}")
fillet_9 = Fillet(Curve=join_25, Radius=Slider(35, range=20..100))  # -> flatten(Curve)
join_26 = JoinCurves(Curves=[fillet_9, flatten_3], Preserve=False)  # -> flatten(Curves)
join_27 = JoinCurves(Curves=[join_26, join_16, tabletoptab], Preserve=False)  # -> flatten(Curves)
front_back_frame = JoinCurves(Curves=[flatten_2, mirror_7.Geometry], Preserve=False)
mirror_8 = Mirror(Geometry=join_27, Plane=yz_5)  # -> flatten(Geometry), Transform
join_28 = JoinCurves(Curves=[join_27, mirror_8.Geometry], Preserve=False)

dist_3 = Distance(PointA=end_41.Start, PointB=cull_24)
division = Division(A=dist_3, B=2)
Y_15 = UnitY(Factor=division)
move_23 = Move(Geometry=end_41.Start, Motion=Y_15)  # -> Geometry, Transform
division_2 = Division(A=sheet_thickness, B=2)
X_10 = UnitX(Factor=division_2)
drill_bit_radius = Slider(3, range=1..5)
move_24 = Move(Geometry=move_23.Geometry, Motion=X_10)  # -> Geometry, Transform
multiplication_5 = Multiplication(A=dist_3, B=2)
circle = CircleCNR(Center=move_24.Geometry, Normal=Vector(0, 0, 1), Radius=drill_bit_radius)
Y_16 = UnitY(Factor=multiplication_5)
move_25 = Move(Geometry=circle, Motion=Y_16)  # -> Geometry, Transform
move_26 = Move(Geometry=move_25.Geometry, Motion=Y_16)  # -> Geometry, Transform
mirror_9 = Mirror(Geometry=[move_26.Geometry, move_25.Geometry, circle], Plane=yz_6)  # -> Geometry, Transform

drill_holes = Group(Objects=[move_26.Geometry, move_25.Geometry, circle, mirror_9.Geometry])

# ----
# Output
# Flat-Top
side_frame = JoinCurves(Curves=[mirror_4.Geometry, join_14], Preserve=False)
table_top = JoinCurves(Curves=[mirror_2.Geometry, join_5], Preserve=False)
front_back_frame_2 = Group(Objects=[drill_holes, front_back_frame])

top_bracket_2 = JoinCurves(Curves=[mirror.Geometry, join_2], Preserve=False)
side_a_frame = Group(Objects=[join_8, join_28])
# A-Frame
tabletop = JoinCurves(Curves=[join_15, mirror_6.Geometry], Preserve=False)
